# Dynamo graph AdaptiveFamilyPlacementByCurveandPoints.dyn "AdaptiveFamilyPlacementByPoints" (Dynamo 2.17.0.3472)

select_curve = DSModelElementSelection()  # 1 picked in the model; graph input
geometry = Element.Geometry(element=select_curve)
code_block = CodeBlock { 1; }
code_block_2 = CodeBlock { 0.25; }
range = Range(end=code_block, step=code_block_2)
pointAtParameter = Curve.PointAtParameter(curve=geometry, param=range, lacing=CrossProduct)
adaptiveFamilyType = StringInput("Adaptive5point")  # graph input
byName = FamilyType.ByName(name=adaptiveFamilyType)
byPoints = AdaptiveComponent.ByPoints(points=pointAtParameter, familyType=byName)
