# Dynamo graph CAD_Layer_to_RevitLine.dyn (Dynamo 2.16.2.5624)
# packages: bimorphNodes 5.1.3, Data-Shapes 2025.3.118, Clockwork for Dynamo 2.x 2.12.2

select_cad = DSModelElementSelection()  # 1 picked in the model; graph input
activeViewFromCurrentDocument = Custom[Document.ActiveViewFromCurrentDocument]()  # package Clockwork for Dynamo 2.x; Gets the active view of the current document
layer_name = StringInput("A-DETL")  # graph input
line_style = StringInput("<Thin Lines>")  # graph input
detailCurvesFromCADLayers = CAD.DetailCurvesFromCADLayers(importInstance=select_cad, view=activeViewFromCurrentDocument, layerNames=layer_name, lineStyleMap=line_style)
boolean = BoolSelector(false)
layerNames = Revit.ImportInstance.LayerNames(importInstance=select_cad)
dropdown_data = Custom[DropDown Data](Keys=layerNames, Values=layerNames)  # frozen; package Data-Shapes; Create data for DropDown input in UI.MultiInputForm ++ . Check out www.data-shapes.net for more infos.
code_block = CodeBlock(x=dropdown_data) { x; }
code_block_2 = CodeBlock(x=dropdown_data) { x[0]; }
if_ = RefactoredIf(test=boolean, true=code_block, false=code_block_2)  # frozen
