# Dynamo graph CutMultipleElementFromVoid.dyn (Dynamo 2.17.0.3472)
# packages: Clockwork for Dynamo 2.x 2.6.0

select_model_elements = DSModelElementsSelection()  # 2 picked in the model; graph input
list_create = List.Create(item0=select_model_elements)
select_void = DSModelElementSelection()  # 1 picked in the model; graph input
list_create_2 = List.Create(item0=select_void)
for_wall_and_floor = Python(IN[0]=list_create, IN[1]=list_create_2)  # CPython3; frozen
# ---------- for_wall_and_floor.python (41 lines) ----------
# Load the Python Standard and DesignScript Libraries
import sys
import clr
clr.AddReference('ProtoGeometry')
from Autodesk.DesignScript.Geometry import *

# The inputs to this node will be stored as a list in the IN variables.
dataEnteringNode = IN

# Place your code below this line
import clr
clr.AddReference('RevitAPI')
clr.AddReference('RevitServices')

from Autodesk.Revit.DB import *
from RevitServices.Persistence import DocumentManager
from RevitServices.Transactions import TransactionManager

# Get the current document
doc = DocumentManager.Instance.CurrentDBDocument

# Unwrap inputs
host_elements = UnwrapElement(IN[0])  # e.g., walls or slabs
void_instances = UnwrapElement(IN[1])  # void family instances

# Start transaction
TransactionManager.Instance.EnsureInTransaction(doc)

results = []
for host in host_elements:
    for void in void_instances:
        try:
            InstanceVoidCutUtils.AddInstanceVoidCut(doc, host, void)
            results.append("Cut applied")
        except Exception as e:
            results.append(str(e))

# End transaction
TransactionManager.Instance.TransactionTaskDone()

OUT = results
# ----------------------------------------
cutGeometry = Custom[Element.CutGeometry](elementToBeCut=select_model_elements, cuttingElement=select_void)  # package Clockwork for Dynamo 2.x; Adds a solid-solid cut for two model elements (if possible).
