# Dynamo graph Renumber element by spline.dyn (Dynamo 2.17.0.3472)

select_model_elements = DSModelElementsSelection()  # 4 picked in the model; graph input
select_spline = DSModelElementSelection()  # 1 picked in the model; graph input
geometry = Element.Geometry(element=select_spline)
XY = Plane.XY()
pullOntoPlane = Curve.PullOntoPlane(curve=geometry, plane=XY)
getLocation = Element.GetLocation(element=select_model_elements)
code_block = CodeBlock(Loc=getLocation) { Point.X(Loc); Point.Y(Loc); }
byCoordinates = Point.ByCoordinates(x=code_block.out0, y=code_block.out1)
closestPointTo = Geometry.ClosestPointTo(geometry=pullOntoPlane, other=byCoordinates, lacing=Longest)
parameterAtPoint = Curve.ParameterAtPoint(curve=pullOntoPlane, point=closestPointTo, lacing=Longest)
sortByKey = List.SortByKey(list=select_model_elements, keys=parameterAtPoint)
parameter = StringInput("Mark")  # graph input
prifix = StringInput("PC")  # graph input
start = DoubleInput(1)  # graph input
end = DoubleInput(4)  # graph input
step = DoubleInput(1)  # graph input
range = Range(start=start, end=end, step=step)
code_block_2 = CodeBlock(a=prifix, b=range) { a+b; }
setParameterByName = Element.SetParameterByName(element=sortByKey.sortedList, parameterName=parameter, value=code_block_2)
