# Dynamo graph SplitFoorByBoundaries.dyn "split floor" (Dynamo 2.17.0.3472)
# packages: archi-lab.net 2024.217.1024, Clockwork for Dynamo 2.x 2.6.0

select_model_element = DSModelElementSelection()  # 1 picked in the model
location = Custom[Element.Location+](element=select_model_element)  # package Clockwork for Dynamo 2.x; Returns the location of an element as point, curve or curve loop, along with some booleans to help filtering the results. Unlike the OOTB Element.GetLocation node, it also returns sketch lines of sketch-based elements like floor slabs as well as the element's rotation property. Additionally, it supports quite a few more element types (e.g. railings, stairs etc.).
type = archilab.Revit.Elements.Elements.Type(element=select_model_element)
levels = Levels("Level 1")
byOutlineTypeAndLevel = Floor.ByOutlineTypeAndLevel(outlineCurves=location.mulipleCurves, floorType=type, level=levels)
list_create = List.Create(item0=select_model_element, item1=byOutlineTypeAndLevel)
contains = List.Contains(list=byOutlineTypeAndLevel, item=select_model_element)
filterByBoolMask = List.FilterByBoolMask(list=list_create, mask=contains)
delete = archilab.Revit.Elements.Elements.Delete(element=filterByBoolMask.out)
