# Dynamo graph TextFromCAD.dyn (Dynamo 2.16.2.5624)
# packages: bimorphNodes 5.1.3

views = Views("Level 0")  # graph input
select_cad = DSModelElementSelection()  # 1 picked in the model; graph input
layer_name = StringInput("S-ANNO-TEXT")  # graph input
fromLayers = CADTextData.FromLayers(importInstance=select_cad, layerNames=layer_name)
originPoint = CADTextData.OriginPoint(cADTextData=fromLayers.CADTextData)
textValue = CADTextData.TextValue(cADTextData=fromLayers.CADTextData)
select_horizontal_text_alignment = HorizontalAlignment("Left")  # graph input
text_type = StringInput("3.5mm Arial")  # graph input
byName = TextNoteType.ByName(name=text_type)
byLocation = TextNote.ByLocation(view=views, location=originPoint, text=textValue, alignment=select_horizontal_text_alignment, type=byName)
