# Dynamo graph VoidPlacementAtIntersection.dyn (Dynamo 2.17.0.3472)
# packages: Genius Loci 2024.2.26, Synthesize toolkit 25.4.1901, Clockwork for Dynamo 2.x 2.6.0

beams = DSModelElementsSelection()  # 2 picked in the model
solids = Element.Solids(element=beams)
byUnion = Custom[Solid.ByUnion+](solids=solids)  # package Clockwork for Dynamo 2.x; The OOTB node Solid.ByUnion occasionally fails when trying to merge solids with almost adjacent faces. This node will return the minimum amount of joined solids possible in such cases instead of returning null.
boundingBox = Geometry.BoundingBox(geometry=byUnion)
toCuboid = BoundingBox.ToCuboid(boundingBox=boundingBox)
centroid = Solid.Centroid(solid=toCuboid)
ZAxis = Vector.ZAxis()
element_getrotation = Custom[Element GetRotation](element=beams)  # package Genius Loci; Calculates the rotation angle between the given element and the X axis. Works for point/ line/ sketch based elements and link instances.
code_block = CodeBlock(x=element_getrotation) { x*-1; }
rotate = Geometry.Rotate(geometry=byUnion, origin=centroid, axis=ZAxis, degrees=code_block)
family_types = FamilyTypes("void:void")
walls = DSModelElementsSelection()  # 2 picked in the model
solids_2 = Element.Solids(element=walls)
byUnion_2 = Custom[Solid.ByUnion+](solids=solids_2)
boundingBox_2 = Geometry.BoundingBox(geometry=byUnion_2)
toCuboid_2 = BoundingBox.ToCuboid(boundingBox=boundingBox_2)
centroid_2 = Solid.Centroid(solid=toCuboid_2)
element_getrotation_2 = Custom[Element GetRotation](element=walls)
code_block_2 = CodeBlock(x=element_getrotation_2) { x*-1; }
rotate_2 = Geometry.Rotate(geometry=byUnion_2, origin=centroid_2, axis=ZAxis, degrees=code_block_2)
boundingBox_3 = Geometry.BoundingBox(geometry=rotate_2)
toCuboid_3 = BoundingBox.ToCuboid(boundingBox=boundingBox_3)
rotate_3 = Geometry.Rotate(geometry=toCuboid_3, origin=centroid_2, axis=ZAxis, degrees=element_getrotation_2)
boundingBox_4 = Geometry.BoundingBox(geometry=rotate_3)
intersection = BoundingBox.Intersection(boundingBox=boundingBox_4, other=boundingBox)
toCuboid_4 = BoundingBox.ToCuboid(boundingBox=intersection)
centroid_3 = Solid.Centroid(solid=toCuboid_4)
byPoint = FamilyInstance.ByPoint(familyType=family_types, point=centroid_3)
setLocationAndRotation = SynthesizeToolkit.Revit.Elements.SetLocationAndRotation(Elements=byPoint, Locations=centroid_3, Rotations=element_getrotation_2)
solids_3 = Element.Solids(element=setLocationAndRotation.Elements)
code_block_3 = CodeBlock { "l"; }
code_block_4 = CodeBlock { "w"; }
code_block_5 = CodeBlock { "h"; }
list_create = List.Create(item0=code_block_3, item1=code_block_4, item2=code_block_5)
boundingBoxDimensions = SynthesizeToolkit.DynamoGeometry.BoundingBox.BoundingBoxDimensions(BoundingBox=intersection)
code_block_6 = CodeBlock(l=boundingBoxDimensions.xLength, w=boundingBoxDimensions.yLength, z=boundingBoxDimensions.zLength) { l; w; z; }
list_create_2 = List.Create(item0=code_block_6.l, item1=code_block_6.w, item2=code_block_6.z)
setParameters = SynthesizeToolkit.Revit.Parameters.SetParameters(Elements=setLocationAndRotation.Elements, Parameters=list_create, Values=list_create_2)
