# Dynamo graph familyTypeRename .dyn "familyTypeRename" (Dynamo 2.17.0.3472)
# packages: archi-lab.net 2024.217.1024, Clockwork for Dynamo 2.x 2.6.0

select_model_elements_by = DSModelElementsByCategorySelection("OST_StructuralColumns")  # "Select Model Elements By Category"; 8 picked in the model; graph input
type = archilab.Revit.Elements.Elements.Type(element=select_model_elements_by)
stringPrifix = StringInput("")  # graph input
type_2 = archilab.Revit.Elements.Elements.Type(element=select_model_elements_by)
first_parameter = StringInput("b")  # graph input
getParameterValueByName = Element.GetParameterValueByName(element=type_2, parameterName=first_parameter)
floor = Math.Floor(number=getParameterValueByName)
add = stringPrifix + floor
stringBetweenParameter = StringInput("x")  # graph input
add_2 = add + stringBetweenParameter
second_parameter = StringInput("h")  # graph input
getParameterValueByName_2 = Element.GetParameterValueByName(element=type, parameterName=second_parameter)
floor_2 = Math.Floor(number=getParameterValueByName_2)
add_3 = add_2 + floor_2
stringSuffix = StringInput("")  # graph input
add_4 = add_3 + stringSuffix
setName = Custom[Element.SetName](element=type, name=add_4)  # package Clockwork for Dynamo 2.x; Gets the name of a given Revit element
