# Dynamo graph rotate column.dyn (Dynamo 2.10.1.3976)

select_model_elements = DSModelElementsSelection()  # 4 picked in the model; graph input
number = DoubleInput(30)  # graph input
setRotation = FamilyInstance.SetRotation(familyInstance=select_model_elements, degree=number)
