# Dynamo graph rotate element at their own axis.dyn (Dynamo 2.10.1.3976)
# packages: Genius Loci 2023.7.13

select_model_elements = DSModelElementsSelection()  # 2 picked in the model; graph input
number = DoubleInput(45)  # graph input
element_setrotation = Custom[Element SetRotation](element=select_model_elements, degree=number)  # package Genius Loci; Set the angle of the element around its local Z-axis. (Same as the Rotate command in Revit)
