# Dynamo graph wall_By_Column_Centerline 1.dyn "Column_Centerline" (Dynamo 2.16.2.5624)
# packages: Synthesize toolkit 25.3.1601

wall_types = WallTypes("Generic - 200mm")
code_block = CodeBlock(x=wall_types) { x+" 01"; }
duplicate = ElementType.Duplicate(elementType=wall_types, name=code_block)  # frozen
getName = SynthesizeToolkit.Revit.Select.GetName(Element=wall_types)
code_block_2 = CodeBlock { " - 200mm"; }
select_model_elements_by = DSModelElementsByCategorySelection("OST_StructuralColumns")  # "Select Model Elements By Category"; 8 picked in the model; graph input
boundingBox = Element.BoundingBox(element=select_model_elements_by)
boundingBoxDimensions = SynthesizeToolkit.DynamoGeometry.BoundingBox.BoundingBoxDimensions(BoundingBox=boundingBox)
max = Math.Max(value1=boundingBoxDimensions.xLength, value2=boundingBoxDimensions.yLength)
string_from_object = FromObject(object=max)
code_block_3 = CodeBlock(x=string_from_object) { " "+x; }
searchReplace = SynthesizeToolkit.Strings.Operations.SearchReplace(Input=getName, SearchFor=code_block_2, ReplaceWith=code_block_3)  # frozen
list_create = List.Create(item0=select_model_elements_by)
minPoint = BoundingBox.MinPoint(boundingBox=boundingBox)
code_block_4 = CodeBlock(x=boundingBoxDimensions.xLength, y=boundingBoxDimensions.yLength) { x>y; }
filterByBoolMask = List.FilterByBoolMask(list=minPoint, mask=code_block_4)
XAxis = Vector.XAxis()
filterByBoolMask_2 = List.FilterByBoolMask(list=max, mask=code_block_4)
byStartPointDirectionLength = Line.ByStartPointDirectionLength(startPoint=filterByBoolMask.in, direction=XAxis, length=filterByBoolMask_2.in)
YAxis = Vector.YAxis()
min = Math.Min(value1=boundingBoxDimensions.xLength, value2=boundingBoxDimensions.yLength)
filterByBoolMask_3 = List.FilterByBoolMask(list=min, mask=code_block_4)
code_block_5 = CodeBlock(x=filterByBoolMask_3.in) { x/2; }
translate = Geometry.Translate(geometry=byStartPointDirectionLength, direction=YAxis, distance=code_block_5)
levels = Levels("Level 1")
levels_2 = Levels("Level 2")
wall_types_2 = WallTypes("Generic - 300mm")  # graph input
byCurveAndLevels = Wall.ByCurveAndLevels(curve=translate, startLevel=levels, endLevel=levels_2, wallType=wall_types_2)
byStartPointDirectionLength_2 = Line.ByStartPointDirectionLength(startPoint=filterByBoolMask.out, direction=YAxis, length=filterByBoolMask_2.out)
code_block_6 = CodeBlock(x=filterByBoolMask_3.out) { x/2; }
translate_2 = Geometry.Translate(geometry=byStartPointDirectionLength_2, direction=XAxis, distance=code_block_6)
levels_3 = Levels("Level 1")
levels_4 = Levels("Level 2")
wall_types_3 = WallTypes("Generic - 300mm")
byCurveAndLevels_2 = Wall.ByCurveAndLevels(curve=translate_2, startLevel=levels_3, endLevel=levels_4, wallType=wall_types_3)
list_create_2 = List.Create(item0=byCurveAndLevels, item1=byCurveAndLevels_2)
string_from_object_2 = FromObject(object=list_create_2)
code_block_7 = CodeBlock { "Wall"; }
contains = List.Contains(list=string_from_object_2, item=code_block_7)
filterByBoolMask_4 = List.FilterByBoolMask(list=list_create, mask=contains)
delete = SynthesizeToolkit.Revit.Elements.Delete(Elements=filterByBoolMask_4.in)
name = FamilyType.Name(familyType=select_model_elements_by)
geometry = Element.Geometry(element=byCurveAndLevels_2)
geometry_2 = Element.Geometry(element=byCurveAndLevels)
